# Grasshopper definition rnd_node2.gh (Grasshopper 1.0.7)
# plug-ins: Bifocals

# ---- group: RH_IN:radius
number_slider = Slider(13, range=0..100)

# ---- group: RH_IN:count
number_slider_2 = Slider(40, range=0..100)

# ----
domain_box = DomainBox(Base=PlaneXY(0, 0, 0), X=number_slider, Y=Slider(13, range=0..100), Z=number_slider_2)
deconstruct_brep = DeconstructBrep(Brep=domain_box)  # -> Faces, Edges, Vertices
md_slider = MDSlider(SliderMode=0, slider_value=Point(0.5, 0.5, 0.5), x_domain=Domain(0, 1), y_domain=Domain(0, 1), z_domain=Domain(0, 1))
list_item = ListItem(List=deconstruct_brep.Faces, Index=Slider(4, range=0..10), Wrap=True)
unit_z = UnitZ(Factor=1)
evaluate_surface = EvaluateSurface(Surface=reparameterize(list_item), Point=md_slider)  # -> Point, Normal, UDirection, VDirection, Frame
project_point = ProjectPoint(Point=evaluate_surface.Point, Direction=unit_z, Geometry=domain_box)  # -> Point, Index
line = Line(StartPoint=evaluate_surface.Point, EndPoint=project_point.Point)
construct_domain = ConstructDomain(DomainStart=Slider(0.18, range=0..1), DomainEnd=Slider(0.91, range=0..1))
sub_curve = SubCurve(BaseCurve=reparameterize(line), Domain=construct_domain)
twist = Twist(Geometry=domain_box, Axis=sub_curve, Angle=degrees(Slider(192, range=0..1000)), Infinite=Toggle(True), Rigid=False)
brep = Brep(twist)
subd_from_mesh = SubDFromMesh(Mesh=twist, Creases=1, Corners=1, Interpolate=False)
mesh_edges = MeshEdges(Mesh=subd_from_mesh)  # -> NakedEdges, InteriorEdges, NonManifoldEdges

# ---- group: RH_OUT:edges
curve = Curve([mesh_edges.NakedEdges, mesh_edges.InteriorEdges])

# ---- group: RH_OUT:mesh
mesh = Mesh(subd_from_mesh)
